# Grasshopper definition MeshToSocket.gh (Grasshopper 0.9.76)
# plug-ins: Socket_Alligator

ticker = CSharpScript(go=Button(), reset=Button())  # -> out, A; inputs go: Boolean, reset: Boolean
# ---------- ticker: C# ----------
    if (reset)
    {
      a = 0;
    }

    if (go)
    {
      a = a + 1;
    }

    A = a;
# ---------- ticker: C# additional code ----------
  public int a = 0;
# ---------- end ticker ----------
Z = UnitZ(Factor="4000")
multiplication = Multiplication(A=Z, B=ticker.A)
move = Move(Motion=multiplication)  # -> Geometry, Transform

# ----
# Internalized Geometry
geo = Geometry([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])
geo_2 = Geometry([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])
geo_3 = Geometry([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])
mjoin = MeshJoin(Meshes=flatten([geo, geo_3, geo_2]))

# ----
# Vertices
demesh = DeconstructMesh(Mesh=mjoin)  # -> Vertices, Faces, Colours, Normals
pt2num = PointsToNumbers(Points=demesh.Vertices, Mask=4)  # -> simplify(Numbers)
partition = PartitionList(List=pt2num, Size=3)  # -> simplify(Chunks)
item = ListItem(List=partition, Index=0, Wrap=True)  # -> Item, Item1, Item2
concat = Concatenate(FragmentA=item.Item, FragmentB=" ", FragmentC=item.Item1, FragmentD=" ", FragmentE=item.Item2)  # -> flatten(Result)
item_2 = ListItem(List=reverse(simplify(concat)), Index=0, Wrap=True)  # -> simplify(Item)
cull_i = CullIndex(List=reverse(simplify(concat)), Indices=0, Wrap=True)  # -> reverse(simplify(List))
concat_2 = Concatenate(FragmentA=simplify(cull_i), FragmentB=simplify(";"))  # -> simplify(Result)
merge = Merge(Data1=simplify(flatten(concat_2)), Data2=simplify(flatten(item_2)))
join = TextJoin(Text=merge)

# ----
# Faces
deface = DeconstructFace(Face=demesh.Faces)  # -> CornerA, CornerB, CornerC, CornerD
concat_3 = Concatenate(FragmentA=deface.CornerA, FragmentB=" ", FragmentC=deface.CornerB, FragmentD=" ", FragmentE=deface.CornerC)
cull_i_2 = CullIndex(List=reverse(concat_3), Indices=0, Wrap=True)  # -> reverse(List)
item_3 = ListItem(List=reverse(concat_3), Index=0, Wrap=True)
concat_4 = Concatenate(FragmentA=cull_i_2, FragmentB=";")
merge_2 = Merge(Data1=simplify(flatten(concat_4)), Data2=simplify(flatten(item_3)))
join_2 = TextJoin(Text=merge_2)

concat_5 = Concatenate(FragmentA="[", FragmentB=join, FragmentC="[", FragmentD=join_2)
len = TextLength(Text=concat_5)
panel = Panel(len)

# ----
# Mesh String To Socket
port = Panel("8001")
tosocket = ToSocket(IPAddress="127.0.0.1", Port=simplify(flatten(port)), Data=flatten(concat_5), Active=Button())
