# Grasshopper definition VR-AL-RhinoToUnreal-TwistyTower-Materials.gh (Grasshopper 0.9.76)
# plug-ins: Human, BH.UI.Grasshopper

cluster_distance = Slider(10, range=0..10)
box = Box2Pt(PointA="0,0,0", PointB="50,50,50", Plane=PlaneXY(0, 0, 0))
pop3d = Populate3D(Region=box, Count=100, Seed=1)
no_smaller_than_m³ = Slider(100, range=0..100)
pgroups = PointGroups(Points=pop3d, Distance=cluster_distance)  # -> Groups, Indices
bbox = BoundingBox(Content=pgroups.Groups, Plane=PlaneXY(0, 0, 0), UnionBox=True)  # -> Box, Box_2
max_no_of_boxes = Slider(5, range=0..10)
volume = Volume(Geometry=bbox.Box)  # -> Volume, Centroid
rot_per_floor = Slider(12, range=0..20)
flr_count = Slider(6, range=5..20)
flr_to_flr = Slider(12, range=0..20)
smaller = SmallerThan(FirstNumber=volume.Volume, SecondNumber=no_smaller_than_m³)  # -> SmallerThan, OrEqualTo
cull = CullPattern(List=bbox.Box, CullPattern=invert(smaller.SmallerThan))  # -> flatten(List)
base_crv = Curve(<curve referenced from the Rhino model>)
twistytower = TwistyTower(base_crv=base_crv, flr_ht=flr_to_flr, flrs=flr_count, rot=rot_per_floor)  # -> skin_2, floors_2
split = SplitList(List=cull, Index=max_no_of_boxes)  # -> ListA, ListB
# Step 1
# Step 2
to_unreal = Data(twistytower.floors_2)

saveindex = Panel("1")
# UNREAL
# SETTINGS
name = Panel("MaterialTest")
scale = Slider(10, range=0..100)

send_to_unreal = BooleanToggle(True)
test_rhino_freeform_srf = Brep(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)
rhino_brep_to_send = Brep(flatten(split.ListA))

volume_2 = Volume(Geometry=rhino_brep_to_send)  # -> Volume, Centroid
pdecon = Deconstruct(Point=volume_2.Centroid)  # -> XComponent, YComponent, ZComponent
bnd = Bounds(Numbers=pdecon.ZComponent)
dedomain = DeconstructDomain(Domain=bnd)  # -> Start, End

edges = BrepEdges(Brep=rhino_brep_to_send)  # -> Naked, Interior, NonManifold
preview = CustomPreview(Geometry=edges.Interior, Shader=ColourSwatch(SwatchColor=RGB(0, 0, 0)))

smesh = SimpleMesh(Brep=rhino_brep_to_send)
tri = Triangulate(Mesh=smesh)  # -> Mesh, Count
meshout = Data(tri.Mesh)

gradient = Gradient(
    LowerLimit=0,
    UpperLimit=dedomain.End,
    Parameter=pdecon.ZComponent,
    stops=[0.15: RGB(255, 130, 160), 0.804: RGB(220, 0, 40)])

lng = ListLength(List=pdecon.ZComponent)
series = Series(Start=0, Step=1, Count=lng)
bnd_2 = Bounds(Numbers=series)
dom = ConstructDomain(DomainStart=Slider(0.2, range=0..1), DomainEnd=Slider(1, range=0..1))
remap = RemapNumbers(Value=series, Source=bnd_2, Target=Domain(0, 1))  # -> reverse(Mapped), Clipped
remap_2 = RemapNumbers(Value=series, Source=bnd_2, Target=dom)  # -> Mapped, Clipped
jitter = Jitter(List=remap.Mapped, Jitter=1, Seed=Slider(12, range=0..100))  # -> Values, Indices
jitter_2 = Jitter(List=gradient, Jitter=1, Seed=Slider(12, range=0..100))  # -> Values, Indices
jitter_3 = Jitter(List=remap_2.Mapped, Jitter=1, Seed=Slider(15, range=0..100))  # -> Values, Indices

rendermaterial = RenderMaterial(
    BaseColor=jitter_2.Values,
    Opacity=jitter_3.Values,
    Glossiness=jitter.Values,
    Emissivity=0,
    Component="{ .RenderMaterial")
# VR TOOLKIT > RESULTS DATA TO UNREAL
number_slider = Slider(0, range=0..100)
number_slider_2 = Slider(1, range=0..1)
medges = MeshEdges(Mesh=meshout)  # -> NakedEdges, InteriorEdges, NonManifoldEdges
send_to_unreal_2 = BooleanToggle(True)
unrealadapter = UnrealAdapter(Address="127.0.0.1", Port=8888, Component="{ ..ctor")

unit = Panel("m/s")
results = Data()
splines = Data()
unrealmesh = UnrealMesh(Mesh=meshout, RenderMaterial=rendermaterial, Component="{ .UnrealMesh")
bnd_3 = Bounds(Numbers=flatten(results))
# Push To Unreal
dedomain_2 = DeconstructDomain(Domain=bnd_3)  # -> Start, End
project = Project(
    Name=name,
    Saveindex=saveindex,
    Scale=scale,
    Unit=unit,
    AcousticMode=False,
    ResultMin=number_slider,
    ResultMax=number_slider_2,
    Splines=flatten(splines),
    Meshes=unrealmesh,
    Component="{ .Project")
push = Push(Adapter=unrealadapter, Objects=project, Active=send_to_unreal, Component="{ .Push")  # -> Objects, Success

unrealprojectsettings = UnrealProjectSettings(
    Name=name,
    Saveindex=saveindex,
    Scale=scale,
    Unit=unit,
    AcousticMode=False,
    ResultMin=number_slider,
    ResultMax=number_slider_2,
    Component="{ .UnrealProjectSettings")
push_2 = Push(Adapter=unrealadapter, Objects=[unrealprojectsettings, unrealmesh], Active=send_to_unreal_2, Component="{ .Push")  # -> Objects, Success

multiplication = Multiplication(A=jitter.Values, B=100)
material = CreateMaterial(
    Diffuse=jitter_2.Values,
    Specular=jitter_2.Values,
    Emission=RGB(0, 0, 0),
    Transparency=expr("1-x", jitter_3.Values),
    Shine=multiplication)
materials = CreateModifyMaterials(Name=jitter_2.Values, Diffuse=jitter_2.Values, Specular=jitter_2.Values, Alpha=jitter_3.Values, Gloss=multiplication)
createatts = CreateAttributes(MaterialName=materials, enableFullPath=False)
bake = BakeGeometry(Bake=Toggle(False), Geometry=rhino_brep_to_send, Attributes=createatts, DeleteOldBakes=False, PreserveTrees=False)
preview_2 = CustomPreview(Geometry=meshout, Shader=material)

panel = Panel(project)

# ==== cluster TwistyTower
base_crv = ClusterInput()
flr_ht = ClusterInput()
flrs = ClusterInput()
rot = ClusterInput()
base_crv_2 = Curve(base_crv)
flr_ht_2 = Data(flr_ht)
flrs_2 = Data(flrs)
rot_2 = Data(rot)
series = Series(Start=0, Step=flr_ht_2, Count=flrs_2)
series_2 = Series(Start=0, Step=rot_2, Count=flrs_2)
pcen = PolygonCenter(Polyline=base_crv_2)  # -> CenterV, CenterE, CenterA
Z = UnitZ(Factor=series)
xy = XYPlane(Origin=pcen.CenterV)
move = Move(Geometry=base_crv_2, Motion=Z)  # -> Geometry, Transform
rotate = Rotate(Geometry=move.Geometry, Angle=degrees(series_2), Plane=xy)  # -> Geometry, Transform
offset = Offset(Curve=rotate.Geometry, Distance=-2, Plane=PlaneXY(0, 0, 0), Corners=1)
Z_2 = UnitZ(Factor=-1)
loft = Loft(Curves=rotate.Geometry, Options={Adjust=False, Closed=False, LoftEnds=0, LoftSimp=0, LoftType=0, Rebuild=10, Refit=0.01})
extr = Extrude(Base=offset, Direction=Z_2)
cap = CapHoles(Brep=loft)
cap_2 = CapHoles(Brep=extr)
cull_i = CullIndex(List=flatten(cap_2), Indices=0, Wrap=True)
skin = Data(cap)
floors = Data(cull_i)
skin_2 = ClusterOutput(skin)
floors_2 = ClusterOutput(floors)
